% Simulink data dictionary SharedDataDictionary.sldd

UI_8 = Simulink.AliasType(BaseType="uint8", DataScope="Imported", HeaderFile="defs.hpp")
UI_16 = Simulink.AliasType(BaseType="uint16", DataScope="Imported", HeaderFile="defs.hpp")
UI_32 = Simulink.AliasType(BaseType="uint32", DataScope="Imported", HeaderFile="defs.hpp")
SI_8 = Simulink.AliasType(BaseType="int8", DataScope="Imported", HeaderFile="defs.hpp")
SI_16 = Simulink.AliasType(BaseType="int16", DataScope="Imported", HeaderFile="defs.hpp")
SI_32 = Simulink.AliasType(BaseType="int32", DataScope="Imported", HeaderFile="defs.hpp")
BOOL = Simulink.AliasType(BaseType="boolean", DataScope="Imported", HeaderFile="fadefs.hpp")

trainTripReason = Simulink.Bus()
  switchToTripModeUncEmStop: boolean
  switchToTripModeStopInSh: boolean
  switchToTripModeBgNotInShList: boolean
  switchToTripModeOverpassEoA: boolean
  switchToTripModeLinkConsErr: boolean
  switchToTripModeRadioMsgTimeDiff: boolean
  switchToTripModeLinkedBgPassedUnexpDir: boolean
  switchToTripModeTrainInStartOfSsp: boolean
  switchToTripModeTrainInStartOfGradPr: boolean
  switchToTripModeVMainEqualZero: boolean
  switchToTripModeBgNotInSrList: boolean
  switchToTripModeMaxSrDistPassed: boolean
  switchToTripModeEoAPassedOvrdDeact: boolean
  switchToTripModeStopInSr: boolean
  switchToTripModeNoValidMa: boolean
  switchToTripModeInNewL1VMainEqual0: boolean
  switchToTripModeNationalTrainTrip: boolean
  switchToTripModeNatTrainTripLevelNotNtc: boolean
  switchToTripModeSysVerNotSupported: boolean

modeSwitchBus = Simulink.Bus()
  switchToOsFrSr: boolean
  switchToLsFrSr: boolean
  switchToSbFrFsLsSrOsUnPtSnRv: boolean
  switchToSbFrNl: boolean
  switchToSbFrSl: boolean
  switchToSbFrSh: boolean
  switchToSbFrNp4: boolean
  switchFrPsToSb22: boolean
  switchToIs: boolean
  switchToNlFrOsSrLsFsShSb: boolean
  switchToNpFrAllModesButIs: boolean
  switchToPsFrSh: boolean
  switchToPtModeFrTr: boolean
  switchToRvFrFsLsOs: boolean
  switchToSfFrSbPsShFsLsSrOsUnTrPtSnRv: boolean
  switchToSlFrSbPs: boolean
  switchToSnFrSb: boolean
  switchToSnFrFsLsSrOsUn: boolean
  switchToSnFrTr: boolean
  switchToUnMode21: boolean
  switchToUnModeFrSb: boolean
  switchToUnModeFrTr: boolean
  switchToFsFrSb: boolean
  switchToFsFrPt: boolean
  switchToFsFrLsSrOs: boolean
  switchToFsFrUnSn: boolean
  switchToLsFrFs: boolean
  switchToLsFrOs: boolean
  switchToLsFrSbPt: boolean
  switchToLsFrSnUn: boolean
  switchToOsFrSbPt: boolean
  switchToOsFrFs: boolean
  switchToOsFrLs: boolean
  switchToOsFrUnSn: boolean
  switchToTripModeUncEmStop: boolean
  tripModeFrSh: boolean
  tripModeFrFsLsOs: boolean
  tripModeFrSr: boolean
  tripModeFrUn: boolean
  tripModeFrSn: boolean
  switchToShFrSbPt: boolean
  switchToShFrSr: boolean
  switchFrPsToSh23: boolean
  switchToShFrFsLsOs: boolean
  switchToShFrUnSn: boolean
  switchToShModeFrTr: boolean
  switchToSrFrFsLsOs: boolean
  switchToSrFrUnSn: boolean
  switchToSrFrSbPt: boolean

Test_FA_BusCreator = Simulink.Bus()
  FA_Input1Bus: boolean
  FA_Input_Bus: boolean

TestPlatform = Simulink.Bus()
  FA_signal1: int8
  FA_signal2: int8
  FA_signal3: int8
  FA_signal4: int8
  FA_signal5: int8
  FA_signal6: int8
  FA_signal7: int8

frOdo = Simulink.Bus()
  frOdoStandstillVh: boolean

frRbc = Simulink.Bus()
  frRbcMsg28_ShAuthorised: boolean
  frRbcMsg27_ShRefused: boolean
  frRbcMsg2SrAuthorised: boolean
  frRbcShRefused: boolean
  frRbcUncondEmStop: boolean

TrackCounter = Simulink.Bus()
  FrLinkBGInfIsInEoa: boolean
  eFEinRearOfStartSsp: boolean
  trainInLsArea: boolean
  eFEinRearOfStartGradPr: boolean
  trainIsPassedMaxDistanceInSr: boolean
  trainInShAreaByTrc: boolean
  trainInAckShAreaByTrc: boolean
  trainInAckLsArea: boolean
  trainInAckOsArea: boolean
  trainInOsArea: boolean
  trainOverpassEoAinL1: boolean
  trainOverpassEoAinL23: boolean

SpeedCheck = Simulink.Bus()
  overrideSpeedLimitOver: boolean
  ReleaseSpeedMonitor: boolean
  speedOverOsModeSpeedLimit: boolean
  speedOverLsModeSpeedLimit: boolean
  speedOverShModeSpeedLimit: boolean

STM = Simulink.Bus()
  frStmNationalTrainTripActive: boolean

ModeAckRequest = Simulink.Bus()
  lsModeAckRequestFrSbPt: boolean
  lsModeRequiredAckRequest: boolean
  lsModeSelectedAckRequest: boolean
  osModeAckRequestFrSbPt: boolean
  osModeRequiredAckRequest: boolean
  osModeSelectedAckRequest: boolean
  shModeAckRequestFrSbPt: boolean
  shModeRequiredAckRequest: boolean
  shModeSelectedAckRequest: boolean
  unModeAckRequestFrSbPt: boolean
  snModeAckRequestFrSb: boolean

EB = Simulink.Bus()
  ebTrainTrip: boolean

SB = Simulink.Bus()
  SBSelectedModeLsNotAck: boolean
  SBSelectedModeShNotAck: boolean
  SBSelectedModeOsNotAck: boolean

frDmi = Simulink.Bus()
  driverStartOfMissionSelected: boolean
  frDmiDrvSelectExitShunting: boolean
  frDmiDriverModeSelectionNl: boolean
  frDmiTrainTripAck: boolean
  frDmiRvModeAck: boolean
  frDmiSnModeAck: boolean
  frDmiUnModeAck: boolean
  frDmiLsModeAck: boolean
  frDmiOsModeAck: boolean
  frDmiShChoseByDrv: boolean
  frDmiShModeAck: boolean
  frDmiDriverChoseModeSh: boolean
  frDmiSrModeAck: boolean
  frDmiOverrideSelection: boolean
  frDmiOsSelectedModeConf: boolean
  frDmiShSelectedModeConf: boolean
  frDmiSomStartSelected: boolean
  frDmiLsSelectedModeConf: boolean

DataValidity = Simulink.Bus()
  trainDataOnBoardValidity: Enum: DataValidityClass
  trainRunNrOnBoardValidity: Enum: DataValidityClass

Constants = Simulink.Bus()
  T_ACK: uint8
  T_MSG_REPETITION: uint8

toDmi = Simulink.Bus()
  toDmiRequiredOsModeFrSbPtAckReq: boolean
  toDmisnModeAckRequestFrSb: boolean
  toDmiUnModeAckRequestFrSbPt: boolean
  toDmiShModeSelectedAckRequest: boolean
  toDmiShModeRequiredAckRequest: boolean
  toDmiShModeAckRequestFrSbPt: boolean
  toDmiOsModeSelectedAckRequest: boolean
  toDmiOsModeRequiredAckRequest: boolean
  toDmiOsModeAckRequestFrSbPt: boolean
  toDmiLsModeSelectedAckRequest: boolean
  toDmiLsModeRequiredAckRequest: boolean
  toDmiLsModeAckRequestFrSbPt: boolean
  toDmiRequiredOsModeAckReq: boolean
  toDmiSelectedOsModeAckReq: boolean
  toDmiRequiredShModeFrSbPtAckReq: boolean
  toDmiShRefusedAnn: boolean
  toDmiRequiredLsModeFrSbPtAckReq: boolean
  toDmiRequiredLsModeAckReq: boolean
  toDmiSelectedLsModeAckReq: boolean
  toDmiTrainTripAckRequest: boolean
  toDmiTrainTripReason: Enum: TripClass
  toDmiRequiredShModeAckReq: boolean
  toDmiSelectedShModeAckReq: boolean
  toDmiUnblockShMode: boolean

TrainSideSignals = Simulink.Bus()
  modeInputSignalGoSleeping: boolean
  modeInputSignalPassiveShunting: boolean
  ETCSEqPower: boolean
  isolationEcr: boolean
  modeInputSignalNl: boolean
  systemFailure: boolean
  activeDesk: Enum: DeskClass

TrackSideSignals = Simulink.Bus()
  frTrcP5_Q_LINKINGREACTION: uint8
  frTrcModeProfileValid: Enum: ModeProfileClass
  frBgP132_Q_ASPECT: boolean
  baliseIsNotInShBgList: boolean
  tracksideSysVersion: Enum: SysVersionClass
  linkingConsistencyErr: boolean
  maL1Valid: boolean
  stopShuntingOnDeskOpeningInfStored: boolean
  timeOverT_NVCONTACT: boolean
  frTrcP3_M_NVCONTACT: uint8
  linkedBgPassedUnexpDir: boolean
  baliseIsNotInSrBgList: boolean
  frBgP137_Q_SRSTOP: boolean
  noSrBgListReceived: boolean
  maL23Valid: boolean
  shBgListStored: boolean
  srBgListStored: boolean
  MaSspGradOnBoard: boolean
  frBgP12_V_MAIN: uint8

frTrcMLeveltr = Simulink.Bus()
  frTrcMLeveltrL0: uint8
  frTrcMLeveltrL1: uint8
  frTrcMLeveltrL2: uint8
  frTrcMLeveltrL3: uint8
  frTrcMLeveltrLNtcA: uint8
  frTrcMLeveltrLNtcB: uint8
  frTrcMLeveltrLNtcC: uint8

levelPermitted = Simulink.Bus()
  levelNtcApermitted: boolean
  levelNtcBpermitted: boolean
  levelNtcCpermitted: boolean
  level0permitted: boolean
  level1permitted: boolean
  level2permitted: boolean
  level3permitted: boolean

levelInList = Simulink.Bus()
  level0InList: boolean
  level1InList: boolean
  level2InList: boolean
  level3InList: boolean
  levelNtcAInList: boolean
  levelNtcBInList: boolean
  levelNtcCInList: boolean

LevelTrans = Simulink.Bus()
  frTrcMLeveltrL0: uint8
  frTrcMLeveltrL1: uint8
  mLeveltrL2: uint8
  frTrcMLeveltrL2: uint8
  frTrcMLeveltrL3: uint8
  mLeveltrL3: uint8
  frTrcMLeveltrLNtcA: uint8
  mLeveltrLNtcA: uint8
  frTrcMLeveltrLNtcB: uint8
  mLeveltrLNtcB: uint8
  frTrcMLeveltrLNtcC: uint8
  mLeveltrLNtcC: uint8
  frTrcLevelTransitionOrderValid: boolean
  frTrcCondLevelTransitionOrderValid: boolean
  sysInitCompleted: boolean

LevelTransitionByTrackside = Simulink.Bus()
  frTrcCondLevelTransitionOrderValid: boolean
  frSmemLevel: Enum: LevelClass
  trainInLevelTransitionArea: boolean
  sysInitCompleted: boolean
  frTrcMLeveltrL0: uint8
  frTrcMLeveltrL1: uint8
  frTrcMLeveltrL2: uint8
  frTrcMLeveltrL3: uint8
  frTrcMLeveltrLNtcA: uint8
  frTrcMLeveltrLNtcB: uint8
  frTrcMLeveltrLNtcC: uint8

BlockOfLevels = Simulink.Bus()
  ntcAMalfunction: boolean
  ntcBMalfunction: boolean
  ntcCMalfunction: boolean
  mobileTerminalMalfunction: boolean
  cfgLevel2Permitted: boolean
  cfgLevel3Permitted: boolean
  cfgLevelNtcAPermitted: boolean
  cfgLevelNtcBPermitted: boolean
  cfgLevelNtcCPermitted: boolean
  frTrcLevelTransitionOrderValid: boolean
  frTrcCondLevelTransitionOrderValid: boolean
  sysInitCompleted: boolean
  trainInLevelTransitionArea: boolean
  frTrcMLeveltrL0: uint8
  frTrcMLeveltrL1: uint8
  frTrcMLeveltrL2: uint8
  frTrcMLeveltrL3: uint8
  frTrcMLeveltrLNtcA: uint8
  frTrcMLeveltrLNtcB: uint8
  frTrcMLeveltrLNtcC: uint8
  frSmemLevel: Enum: LevelClass
  frDmiLevelChoseByDriver: Enum: LevelExtensionClass

BlockOfLevels_LevelTransitionByDriver = Simulink.Bus()
  ntcAMalfunction: boolean
  ntcBMalfunction: boolean
  ntcCMalfunction: boolean
  mobileTerminalMalfunction: boolean
  cfgLevel2Permitted: boolean
  cfgLevel3Permitted: boolean
  cfgLevelNtcAPermitted: boolean
  cfgLevelNtcBPermitted: boolean
  cfgLevelNtcCPermitted: boolean
  frTrcMLeveltrL0: uint8
  frTrcMLeveltrL1: uint8
  frTrcMLeveltrL2: uint8
  frTrcMLeveltrL3: uint8
  frTrcMLeveltrLNtcA: uint8
  frTrcMLeveltrLNtcB: uint8
  frTrcMLeveltrLNtcC: uint8

defaultLevelsForDriver = Simulink.Bus()
  defaultL0: boolean
  defaultL1: boolean
  defaultL2: boolean
  defaultL3: boolean
  defaultLNtcA: boolean
  defaultLNtcB: boolean
  defaultLNtcC: boolean

BlockOfLevels_TrAck = Simulink.Bus()
  ntcAMalfunction: boolean
  ntcBMalfunction: boolean
  ntcCMalfunction: boolean
  mobileTerminalMalfunction: boolean
  cfgLevel2Permitted: boolean
  cfgLevel3Permitted: boolean
  cfgLevelNtcAPermitted: boolean
  cfgLevelNtcBPermitted: boolean
  cfgLevelNtcCPermitted: boolean
  frTrcLevelTransitionOrderValid: boolean
  frTrcCondLevelTransitionOrderValid: boolean
  sysInitCompleted: boolean
  trainInLevelTransitionArea: boolean
  frTrcMLeveltrL0: uint8
  frTrcMLeveltrL1: uint8
  frTrcMLeveltrL2: uint8
  frTrcMLeveltrL3: uint8
  frTrcMLeveltrLNtcA: uint8
  frTrcMLeveltrLNtcB: uint8
  frTrcMLeveltrLNtcC: uint8
  frSmemLevel: Enum: LevelClass
  frDmiLevelChoseByDriver: Enum: LevelExtensionClass
  defaultL0: boolean
  defaultL1: boolean
  defaultL2: boolean
  defaultL3: boolean
  defaultLNtcA: boolean
  defaultLNtcB: boolean
  defaultLNtcC: boolean
  frSMemNationalSystem: Enum: NationalSystemClass
  mode: Enum: ModeClass
  TrainInLevelTransitionAckArea: boolean
  frDmiLevelAck: boolean
  TrainInLevelTransitionArea: boolean
  frTrcP41_D_LEVELTR: uint16

SharedConfiguration = Simulink.ConfigSet(StartTime="0", StopTime="inf", FixedStep="0.001", Solver="FixedStepDiscrete", ProdHWDeviceType="Intel->x86-64 (Windows64)", SystemTargetFile="ert.tlc", TargetLang="C++")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

TrainSimulatorAfterDefault = Simulink.Bus()
  VelocityStart: double, Min=0
  VelocityReq: double, Min=0
  VelocityMaximal: double, Min=0
  VelocityMinimal: double, Min=0
  MethodOfSpeedChange: double, Min=1, Max=5
  PowerMaximum: double, Min=1, Max=5
  PowerRelative: double, Min=1, Max=5
  TractionForce: double, Min=1, Max=5
  RoadResistEnable: double, Min=0, Max=1
  RoadVehicleResist: double, Min=0
  RoadTrackResist: double, Min=0
  RoadDynamResist: double, Min=0
  Acceleration: double
  Gradient: double, Min=0
  WeightOfTrain: double, Min=0
  GravitationalAcceleration: double, Min=0
  CI_Overreading: double
  CI_Underreading: double
  CI_AfterReset: double
  DrivingDirection: uint8, Min=0, Max=2
  Reset: double

TrainSimulator = Simulink.Bus()
  VelocityStart: double, Min=0
  VelocityStartDefault: double, Min=0
  VelocityReq: double, Min=0
  VelocityReqDefault: double, Min=0
  VelocityMaximal: double, Min=0
  VelocityMaximalDefault: double, Min=0
  VelocityMinimal: double, Min=0
  VelocityMinimalDefault: double, Min=0
  MethodOfSpeedChange: double, Min=1, Max=5
  MethodOfSpeedChangeDefault: double, Min=1, Max=5
  PowerMaximum: double, Min=1, Max=5
  PowerMaximumDefault: double, Min=1, Max=5
  PowerRelative: double, Min=1, Max=5
  PowerRelativeDefault: double, Min=1, Max=5
  TractionForce: double, Min=1, Max=5
  TractionForceDefault: double, Min=1, Max=5
  RoadResistEnable: double, Min=0, Max=1
  RoadResistEnableDefault: double, Min=0, Max=1
  RoadVehicleResist: double, Min=0
  RoadVehicleResistDefault: double, Min=0
  RoadTrackResist: double, Min=0
  RoadTrackResistDefault: double, Min=0
  RoadDynamResist: double, Min=0
  RoadDynamResistDefault: double, Min=0
  Acceleration: double
  AccelerationDefault: double
  Gradient: double
  GradientDefault: double
  WeightOfTrain: double, Min=0
  WeightOfTrainDefault: double, Min=0
  GravitationalAcceleration: double, Min=0
  CI_Overreading: double
  CI_OverreadingDefault: double
  CI_Underreading: double
  CI_UnderreadingDefault: double
  CI_AfterReset: double
  CI_AfterResetDefault: double
  DrivingDirection: uint8, Min=0, Max=2
  DrivingDirectionDefault: uint8, Min=0, Max=2
  Reset: double, Min=0, Max=1